# Dynamo graph EnergyAnalysisForDynamo_ex1b_CreateEnergyModelAndSetSurfaceParams.dyn (Dynamo 0.7.2.10743)

# note: 1. Select Mass element from Revit/Vasari document
select_model_element = DSModelElementSelection()  # 1 picked in the model
levels = Levels("Level 1")
# note: 2. Create Analysis Zones From Mass and Levels
createEnergyModelFromMassAndLevels = EnergyAnalysisForDynamo.PrepareEnergyModel.CreateEnergyModelFromMassAndLevels(select_model_element, levels)
# note: 3. Draw Surfaces
drawAnalysisSurface = EnergyAnalysisForDynamo.PrepareEnergyModel.DrawAnalysisSurface(createEnergyModelFromMassAndLevels.out2)
surface_index = IntegerSlider(3, range=0..10)
# note: 4. Highlight the modified surface
getItemAtIndex = List.GetItemAtIndex(drawAnalysisSurface, surface_index)
getItemAtIndex_2 = List.GetItemAtIndex(createEnergyModelFromMassAndLevels.out2, surface_index)
glazing = DoubleSlider(0.6, range=0.2..0.8)
shading_depth = DoubleSlider(1, range=0..1.5)
sill_height = DoubleSlider(1, range=0..2)
conceptual_construction_types = ConcConstTypeDropdown("HighMassConstructionHighInsulation")  # "Conceptual Construction Types Dropdown"
# note: 5. Customize parameters for the surface of interest
setWallSurfaceParameters = EnergyAnalysisForDynamo.PrepareEnergyModel.SetWallSurfaceParameters(getItemAtIndex_2, glazing, shading_depth, sill_height, conceptual_construction_types)
