# Dynamo graph EnergyAnalysisForDynamo_ex1c_CreateEnergyModelAndSetZoneParams.dyn (Dynamo 0.7.4.3245)

# note: 1. Select Mass from Revit/Vasari document
select_model_element = DSModelElementSelection()  # 1 picked in the model
levels = Levels("Level 1")
# note: 2. This node prepares the energy model and outputs zoneIds and surfaceIds.
# Model setting will be inherited from Revits's EnergySetting. You can customize the setting for any zone or surface using SetSurfaceParameters and SetZoneParameters nodes.
createByMassLevels = EnergyAnalysisForDynamo.PrepareEnergyModel.CreateByMassLevels(select_model_element, levels)
zone_index = IntegerSlider(3, range=0..10)
getItemAtIndex = List.GetItemAtIndex(createByMassLevels.out1, zone_index)
decomposeZone = EnergyAnalysisForDynamo.PrepareEnergyModel.DecomposeZone(getItemAtIndex)
drawAnalysisSurface = EnergyAnalysisForDynamo.PrepareEnergyModel.DrawAnalysisSurface(decomposeZone)
space_types_dropdown = SpaceTypeDropdown("OfficeCommonActivityAreasInactiveStorage")
condition_types_dropdown = ConditionType("HeatedAndCooled")
# note: 4. Modify Zone Parameter
setZoneParameters = EnergyAnalysisForDynamo.PrepareEnergyModel.SetZoneParameters(getItemAtIndex, space_types_dropdown, condition_types_dropdown)
# note: 3. Draw Zones, Highlight selected zone, and decompose zone example
drawAnalysisZone = EnergyAnalysisForDynamo.PrepareEnergyModel.DrawAnalysisZone(createByMassLevels.out1)
drawAnalysisZone_2 = EnergyAnalysisForDynamo.PrepareEnergyModel.DrawAnalysisZone(getItemAtIndex)
