# Dynamo graph EnergyAnalysisForDynamo_ex1d_iterativeAnalysisExample.dyn (Dynamo 0.7.2.2114)

surface_index = IntegerSlider(3, range=0..10)
glazing = DoubleSlider(0.8, range=0.2..0.8)
shading_depth = DoubleSlider(3, range=0.2..3)
sill_height = DoubleSlider(0.386, range=0..5)
conceptual_construction_types = ConcConstTypeDropdown(index=0)  # "Conceptual Construction Types Dropdown"
add = _ + _
code_block = CodeBlock { x + y + z; }
code_block_2 = CodeBlock { {1,2,3}; }
code_block_3 = CodeBlock { 0.1..0.9..0.01; }
count = Count(code_block_3)
ofRepeatedItem = List.OfRepeatedItem(code_block_2, count)
code_block_4 = CodeBlock { 100; }
laceLongest = List.LaceLongest(code_block, ofRepeatedItem, code_block_3, code_block_4)
code_block_5 = CodeBlock { x + y + z; }
create = List.Create(code_block_4)
code_block_6 = CodeBlock { 1; }
code_block_7 = CodeBlock { 2; }
code_block_8 = CodeBlock { 3; }
iterativeSetGlazing = Custom[IterativeSetGlazing]()
# note: 1. Select Mass element from Revit/Vasari document
select_model_element = DSModelElementSelection()  # 1 picked in the model
levels = Levels(index=0)
# note: 2. Create Analysis Zones From Mass and Levels
createEnergyModelFromMassAndLevels = EnergyAnalysisForDynamo.PrepareEnergyModel.CreateEnergyModelFromMassAndLevels(select_model_element, levels)
code_block_9 = CodeBlock { 0.1..0.9..0.05; }
count_2 = Count(code_block_9)
ofRepeatedItem_2 = List.OfRepeatedItem(createEnergyModelFromMassAndLevels.out2, count_2)
laceLongest_2 = List.LaceLongest(arg1=ofRepeatedItem_2, arg2=code_block_9)
isNull = Object.IsNull(laceLongest_2)
code_block_10 = CodeBlock { 0; }
code_block_11 = CodeBlock { 1; }
if_ = If(isNull, code_block_10, code_block_11)
exportMassToGBXML = EnergyAnalysisForDynamo.RunAnalysis.ExportMassToGBXML(arg1=createEnergyModelFromMassAndLevels.out0, arg2=if_)
code_block_12 = CodeBlock { a + ToString(b); }
code_block_13 = CodeBlock { 1; }
chop = List.Chop(code_block_9, code_block_13)
code_block_14 = CodeBlock(x=chop) { ToString(x); }
concat = String.Concat()
code_block_15 = CodeBlock { "C:\Users\BHowes\Desktop\gbTester2_"; }
laceLongest_3 = List.LaceLongest(concat, code_block_15, code_block_9)
create_2 = List.Create(code_block_15)
