# Dynamo graph EnergyAnalysisForDynamo_ex2a_DriveSurfacesByOrientation.dyn (Dynamo 0.8.0.950)

# note: 1. Select Mass element from Revit/Vasari document
select_model_element = DSModelElementSelection()  # 1 picked in the model
# note: 2. Create Analysis Zones from Mass
createByMass = EnergyAnalysisForDynamo.PrepareEnergyModel.CreateByMass(select_model_element)
# note: 3. Get wall surfaces from the list of zones, and compute glazing percentage based on orientation
decomposeZone = EnergyAnalysisForDynamo.PrepareEnergyModel.DecomposeZone(createByMass.out1)
isEmpty = List.IsEmpty(decomposeZone, lacing=Longest)
# note: Filter List, remove empty list
filterByBoolMask = List.FilterByBoolMask(list=decomposeZone, mask=isEmpty)
code_block = CodeBlock { 1; }
# note: Flatten Wall Surface Ids
flatten = List.Flatten(list=filterByBoolMask.out, amt=code_block)
YAxis = Vector.YAxis()
analysisSurfaceVector = EnergyAnalysisForDynamo.PrepareEnergyModel.AnalysisSurfaceVector(filterByBoolMask.out)
dot = Vector.Dot(YAxis, analysisSurfaceVector)
abs = Math.Abs(dot)
code_block_2 = CodeBlock { 1; }
# note: Flatten Values
flatten_2 = List.Flatten(list=abs, amt=code_block_2)
number_slider = DoubleSlider(0.2, range=0.2..0.8 step 0.1)
number_slider_2 = DoubleSlider(0.8, range=0.2..0.8 step 0.1)
# note: Glazing Percentage remapped per orientation
remapRange = Math.RemapRange(numbers=flatten_2, newMin=number_slider, newMax=number_slider_2)
code_block_3 = CodeBlock { 1; }
# note: 4.  Set Glazing percentages based on orientation
setWallSurfaceParameters = EnergyAnalysisForDynamo.PrepareEnergyModel.SetWallSurfaceParameters(flatten, remapRange, arg3=code_block_3)
# note: 5. Draw Surfaces in Dynamo
drawAnalysisSurface = EnergyAnalysisForDynamo.PrepareEnergyModel.DrawAnalysisSurface(setWallSurfaceParameters)
