# Dynamo graph EnergyAnalysisForDynamo_ex3a_CreategbXMLfromMass.dyn (Dynamo 0.7.2.16963)

file_path = Filename("No file selected.")
# note: 1. Set the file location and name it.
# File extention is not needed
# note: 2. Select Mass from Revit/Vasari document
select_model_element = DSModelElementSelection()
boolean = BoolSelector(true)
# note: 3. To run an energy analysis you need to compile a gbXML file from a Mass or zones. This node will export a gbXML file for a mass.
exportMassToGBXML = EnergyAnalysisForDynamo.RunAnalysis.ExportMassToGBXML(file_path, select_model_element, boolean)
