# Dynamo graph EnergyAnalysisForDynamo_ex3b_CreategbXMLfromZones.dyn (Dynamo 0.7.2.16963)

# note: 2. Set filepath and name of gbXML file and selects Zones to be exported as gbXML
file_path = Filename("C:\Users\MSadeghipourroudsari\Desktop\test2.XML")
# note: 1. Select Mass from Revit/Vasari document
select_model_element = DSModelElementSelection()
createEnergyModelFromMass = EnergyAnalysisForDynamo.PrepareEnergyModel.CreateEnergyModelFromMass(select_model_element)
boolean = BoolSelector(true)
# note: 3. To run an energy analysis you need to compile a gbXML file from a Mass or zones.
# This node will export a gbXML file from selected zones. Unlike ExportMassToGBXML you have the chance to select the zones that you want to be exported and also modify zone or surface parameters.
exportZonesToGBXML = EnergyAnalysisForDynamo.RunAnalysis.ExportZonesToGBXML(file_path, createEnergyModelFromMass.out1, boolean)
watch = Watch(exportZonesToGBXML.out0)
watch_2 = Watch(exportZonesToGBXML.out1)
