# Dynamo graph EnergyAnalysisForDynamo_ex6_DownloadDetailedResults.dyn (Dynamo 0.8.0.950)

boolean = BoolSelector(true)
# note: In this example file you can see how you can load the results from Green Building Studio
getProjectsList = EnergyAnalysisForDynamo.GetAnalysisResults.GetProjectsList(boolean)
watch = Watch(getProjectsList.out1)
# note: Select project item
select_project_item = CodeBlock(x=getProjectsList.out0) { x[0]; }
# note: Get Run List of selected Project
getRunIds = EnergyAnalysisForDynamo.GetAnalysisResults.GetRunIds(select_project_item)
# note: First you need to load the results for your design option and then use that to get specific results. Check the nodes on the right.
runId = CodeBlock(x=getRunIds.out1) { x[0]; }
energy_data_file_types_dropdown = EnergyDataFileTypes("gbXML")
directory_path = Directory("C:\Users\EErtugrul\Desktop")
getEnergyModelFiles = EnergyAnalysisForDynamo.GetAnalysisResults.GetEnergyModelFiles(runId, energy_data_file_types_dropdown, directory_path)
