# Dynamo graph EnergySimForDynamo_ex1b_CreateEnergyModelAndSetSurfaceParams.dyn (Dynamo 0.7.2.16963)

# note: 1. Select Mass element from Revit/Vasari document
select_model_element = DSModelElementSelection()  # 1 picked in the model
levels = Levels(index=0)
# note: 2. Create Analysis Zones From Mass and Levels
createEnergyModelFromMassAndLevels = EnergyAnalysisForDynamo.PrepareEnergyModel.CreateEnergyModelFromMassAndLevels(select_model_element, levels)
# note: 3. Draw Surfaces
drawAnalysisSurface = EnergyAnalysisForDynamo.PrepareEnergyModel.DrawAnalysisSurface(createEnergyModelFromMassAndLevels.out2)
surface_index = IntegerSlider(3, range=0..10)
getItemAtIndex = List.GetItemAtIndex(drawAnalysisSurface, surface_index)
conceptual_construction_types = ConcConstTypeDropdown(index=0)  # "Conceptual Construction Types Dropdown"
getItemAtIndex_2 = List.GetItemAtIndex(createEnergyModelFromMassAndLevels.out2, surface_index)
glazing = DoubleSlider(0.8, range=0.2..0.8)
shading_depth = DoubleSlider(3, range=0.2..3)
sill_height = DoubleSlider(0.386, range=0..5)
# note: 4. Set Surface parameters
setSurfaceParameters = EnergyAnalysisForDynamo.PrepareEnergyModel.SetSurfaceParameters(getItemAtIndex_2, glazing, shading_depth, sill_height)
code_block = CodeBlock { "MassRunOffIntegrated"; }
code_block_2 = CodeBlock { 239532; }
createNewProject = EnergyAnalysisForDynamo.RunAnalysis.CreateNewProject()
code_block_3 = CodeBlock { 1; }
getProjectsList = EnergyAnalysisForDynamo.GetAnalysisResults.GetProjectsList(code_block_3)
integer_slider = IntegerSlider(2, range=0..10)
getItemAtIndex_3 = List.GetItemAtIndex(getProjectsList, integer_slider)
code_block_4 = CodeBlock { "c:/test/testNewConfig3.xml"; }
code_block_5 = CodeBlock { 1; }
exportMassToGBXML = EnergyAnalysisForDynamo.RunAnalysis.ExportMassToGBXML(code_block_4, createEnergyModelFromMassAndLevels.out0, code_block_5)
runEnergyAnalysis = EnergyAnalysisForDynamo.RunAnalysis.RunEnergyAnalysis(getItemAtIndex_3, exportMassToGBXML.out1)
getRunIds = EnergyAnalysisForDynamo.GetAnalysisResults.GetRunIds(getItemAtIndex_3)
watch = Watch(getRunIds)
getRunIds_2 = EnergyAnalysisForDynamo.GetAnalysisResults.GetRunIds()
loadAnalysisResults = EnergyAnalysisForDynamo.GetAnalysisResults.LoadAnalysisResults()
getEnergyModelFiles = EnergyAnalysisForDynamo.GetAnalysisResults.GetEnergyModelFiles()
