# Dynamo graph GBSforDynamo_ex1b_CreateEnergyModelAndSetSurfaceParams.dyn (Dynamo 0.7.1.9856)

select_model_element = DSModelElementSelection()  # 1 picked in the model
levels = Levels(index=0)
createFromMassAndLevels = GBSforDynamo.AnalysisZones.CreateFromMassAndLevels(select_model_element, levels)
surface_index = IntegerSlider(6, range=0..10)
getItemAtIndex = List.GetItemAtIndex(createFromMassAndLevels.out2, surface_index)
glazing = DoubleSlider(0.4699970154, range=0.2..0.8)
shading_depth = DoubleSlider(3, range=0.2..3)
sill_height = DoubleSlider(2, range=0..5)
setSurfaceParameters = GBSforDynamo.AnalysisZones.SetSurfaceParameters(getItemAtIndex, glazing, shading_depth, sill_height)
drawAnalysisSurface = GBSforDynamo.AnalysisZones.DrawAnalysisSurface(createFromMassAndLevels.out0, createFromMassAndLevels.out2)
getItemAtIndex_2 = List.GetItemAtIndex(drawAnalysisSurface, surface_index)
conceptual_construction_types = ConcConstTypeDropdown(index=0)  # "Conceptual Construction Types Dropdown"
