# Dynamo graph GBSforDynamo_ex1c_CreateEnergyModelAndSetZoneParams.dyn (Dynamo 0.7.2.17586)

# note: 1. Select Mass from Revit/Vasari document
select_model_element = DSModelElementSelection()
levels = Levels(index=0)
# note: 2. Select Mass from Revit/Vasari document
createFromMassAndLevels = GBSforDynamo.AnalysisZones.CreateFromMassAndLevels(select_model_element, levels)
surface_index = IntegerSlider(3, range=0..10)
getItemAtIndex = List.GetItemAtIndex(createFromMassAndLevels.out1, surface_index)
# note: 3. Decompose Zone
decomposeMassZone = GBSforDynamo.AnalysisZones.DecomposeMassZone(getItemAtIndex)
drawAnalysisSurface = GBSforDynamo.AnalysisZones.DrawAnalysisSurface(decomposeMassZone)
space_types_dropdown = SpaceTypeDropdown(index=95)
condition_types_dropdown = ConditionType(index=2)
# note: 4. Modify Zone Parameter
setZoneParameters = GBSforDynamo.AnalysisZones.SetZoneParameters(getItemAtIndex, space_types_dropdown, condition_types_dropdown)
