# Dynamo graph GBSforDynamo_ex3b_CreategbXMLfromZones.dyn (Dynamo 0.7.2.16963)

file_path = Filename("C:\Users\MSadeghipourroudsari\Desktop\test2.XML")
select_model_element = DSModelElementSelection()  # 1 picked in the model
createFromMass = GBSforDynamo.AnalysisZones.CreateFromMass(select_model_element)
boolean = BoolSelector(true)
gbXMLCompilerFromZones = GBSforDynamo.GBSConnection.gbXMLCompilerFromZones(file_path, createFromMass.out1, boolean)
watch = Watch(gbXMLCompilerFromZones.out0)
watch_2 = Watch(gbXMLCompilerFromZones.out1)
