# Dynamo graph GBSforDynamo_ex5a_GetRunResultsSummary.dyn (Dynamo 0.7.2.17586)

boolean = BoolSelector(true)
# note: Get Project List at GBS web service
getProjectLists = GBSforDynamo.GBSConnection.GetProjectLists(boolean)
code_block = CodeBlock(x=getProjectLists) { x[2]; }
# note: Get Run List of a Project
getRunList = GBSforDynamo.GBSConnection.GetRunList(code_block)
# note: Alt run Id is defaut 0 for Base Model
code_block_2 = CodeBlock(x=getRunList) { x[0]; }
# note: Get Results Summary
results_EnergyAndCarbonResults = GBSforDynamo.GBSConnection.Results_EnergyAndCarbonResults(code_block_2)
# note: Get Carbon Neutral Potential
results_GetCarbonNeutralPotential = GBSforDynamo.GBSConnection.Results_GetCarbonNeutralPotential(results_EnergyAndCarbonResults)
# note: Get Energy Carbon Cost Summary
results_GetEnegrgyCarbonCostSummary = GBSforDynamo.GBSConnection.Results_GetEnegrgyCarbonCostSummary(results_EnergyAndCarbonResults)
# note: Get Electric Power Plant Sources
results_GetElectricPowerPlantSources = GBSforDynamo.GBSConnection.Results_GetElectricPowerPlantSources(results_EnergyAndCarbonResults)
